# Grasshopper definition cluster2.gh (Grasshopper 1.0.7)
# plug-ins: sof_gh_sofistik-2022

io = IO(
    SofistikDocumentProperties_VersionMajor="2022",
    SofistikDocumentProperties_VersionMinor="4",
    SofistikDocumentProperties_VersionName="2022")
vec = Vector()
vec_2 = Vector()
vec_3 = Vector()
vec_4 = Vector()
vec_5 = Vector(vec_2)
vec_6 = Vector(vec_3)
vec_7 = Vector(vec_4)
